% Simulink data dictionary ex_cc_myTypes.sldd

fault_T = enum(DataScope="Imported", HeaderFile="ex_cc_simpleTypes.h", DefaultValue="PWR_LOSS")
  PWR_LOSS = 0
  OVERSPD = 1
  PRESS_LOW = 2

params_T = Simulink.Bus(DataScope="Imported", HeaderFile="ex_cc_simpleTypes.h")
  coeff: double
  init: double

my_ints_T = Simulink.Bus(DataScope="Imported", HeaderFile="ex_cc_struct_alias.h")
  accum: sint_32
  index: uint_16

sint_32 = Simulink.AliasType(BaseType="int32", DataScope="Imported", HeaderFile="ex_integer_aliases.h")
uint_16 = Simulink.AliasType(BaseType="uint16", DataScope="Imported", HeaderFile="ex_integer_aliases.h")